vi "Main.gviweb"   [LabVIEW NXG 3.0.0]
panel controls:
  "Sample Length (s)": i32 = 10
  "Signal Amplitude": f64 = 1
  "Sample Rate (Hz)": i32 = 100
  "Noise %": f64 = 25
  "Signal Frequency": f64 = 1
  "Hyperlink Control": string = "https://github.com/ni/webvi-examples/tree/ad0a92c4696674f290b4e2a02c514360be7b299d/Call%20LabVIEW%20Web%20Service"
  "Hyperlink Control_2": string = "https://github.com/ni/webvi-examples/tree/ad0a92c4696674f290b4e2a02c514360be7b299d/Call%20LabVIEW%20Web%20Service"
  "URL Configuration": T1 = "Use Absolute URLs and Local Debugging"
panel indicators:
  "Observed Data and Fitted Curve": cluster{"Element 1": f64, "Element 2": f64}[][]
  "Signal": cluster{"Element 1": f64, "Element 2": f64}[]
  "Spectrum": cluster{"Element 1": f64, "Element 2": f64}[]
  "LED": bool
types:
  T1 = enum{"Use Absolute URLs and Local Debugging", "Use Relative URLs and Application Web Server"}
uses:
  NI::G Core::Error::Clear Error Cluster.gvi
  NI::HTTP::GET.gvi
  NI::G Core::Error::Build Error Cluster.gvi
diagram:
  # Get data from LabVIEW Web service, unflatten the data, and format it so it can be displayed in a single graph.
  #
  # Post data to LabVIEW Web service, unflatten the  response data, format the data, and plot on two graphs
  s1 = uninitialised  # shift register
  while {
    case ($"URL Configuration") {
      frame "Use Absolute URLs and Local Debugging", Default {
        w1 = "http://127.0.0.1:8001/Web_Server/"
      }
      frame "Use Relative URLs and Application Web Server" {
        w1 = ""
      }
    }
    Concatenate Strings(w1, "SignalAndSpectrum") -> w2
    Concatenate Strings(w1, "ParametricCurve") -> w3
    case (s1) {
      frame Error, Default {
        call "Clear Error Cluster.gvi"(error in=s1) -> (error out=w5)
        call "GET.gvi"(url=w3, error in=w5) -> (status code=w6, error out=w7)
        case (w6) {
          frame 0, Default {
            call "Build Error Cluster.gvi"(error in=w7, code=-1) -> (error out=w4)
          }
          frame 200 {
            w4 = w7
          }
        }
        # If there is an error or if the server responds with anything other than 200 OK, highlight the text pointing to where to download the LabVIEW Web service. HTTP errors are mostly likely due to the Web service not running.
        Property Node(instance in=w4) -> ("status"=w8)
        $LED <- w8
      }
      frame No Error {
        call "ObservedDataAndFittedCurve.gviweb"(String=w3, selector=s1) -> (Observed Data and Fitted Curve=w9, error in=w10)
        call "SetSignalParameters.gviweb"(String=w2, Sample Length (s)=$"Sample Length (s)", Sample Rate (Hz)=$"Sample Rate (Hz)", Signal Frequency=$"Signal Frequency", Signal Amplitude=$"Signal Amplitude", Noise %=$"Noise %", error in=w10) -> (Spectrum=w11, Signal=w12, Error=w4)
        $Spectrum <- w11
        $Signal <- w12
        $"Observed Data and Fitted Curve" <- w9
      }
    }
    # This event structure will cause the loop to
    # wait for one of the inputs to change, so that
    # we will only call into the Web Service when
    # there is a change in what is requested
    event {
      on "Noise %" Value changed; "Signal Amplitude" Value changed; "Signal Frequency" Value changed { }
      on "Sample Length (s)" Value changed; "Sample Rate (Hz)" Value changed { }
      on "URL Configuration" Value changed { }
    }
    next s1 = w4
    stop if FALSE
  }
