vi "MobileTest.gviweb"   [LabVIEW NXG 2.1.0]
panel controls:
  "Button": bool
panel indicators:
  "example.skyline-data-services.string_indicator": string
  "bool test": bool
  "numeric test": bool
  "string test": bool
  "Output": error
  "test": bool
  "String": string
uses:
  subvis::Initialize.gvi
  subvis::Write Example Tags.gvi
  subvis::Read Example Tags.gvi
diagram:
  w1 = "run test"  # Type
  s1 = w1  # shift register
  while {
    case (s1) {
      frame "run test", Default {
        for (N = 5) {
          Random Number() -> (number (0 to 1)=w4)
          append w4 to w3
        }
        Array Index(array=w3) -> (out0[_]=w5, out1[_]=w6, out2[_]=w7, out3[_]=w8, out4[_]=w9)
        Format Into String(w7) -> w10
        # YOU MUST ENTER AN API KEY
        Round To Nearest(number=w5) -> w11
        Is Equal To 0(x=w11) -> w12
        Multiply(w6, 100) -> w13
        Round To Nearest(number=w13) -> w14
        call "Initialize.gvi"(api key="r3bqJR0_h2dnWWHTs2a3pZByD508JBem7eJ4raqj4l", AuthPicker="API Key") -> (error out=w15, tags=w16)
        call "Write Example Tags.gvi"(tags in=w16, example.skyline-data-services.int_control=w12, example.skyline-data-services.numeric_slider-control=w14, example.skyline-data-services.string_control=w10, Skyline.Examples.Oven.Inside.Temp-slider-control=w8, Skyline.Examples.Oven.Outside.Temp-slider-control=w9, error in=w15) -> (tags out=w17, errror out=w18)
        sequence {
          frame 0 {
            Wait(time to wait=250)
          }
        }
        call "Read Example Tags.gvi"(tags in=w17, error in=w18) -> (example.skyline-data-services.int_indicator=w19, example.skyline-data-services.numeric_gauge-indicator=w20, example.skyline-data-services.string_indicator=w21, Skyline.Examples.Oven.Outside.Temp-tank-indicator=w22, error out=w23)
        sequence (after w8) (after w22) {
          frame 0 {
            Is Equal(x=w14, y=w20) -> w24
            $"numeric test" <- w24
            Is Equal(x=w12, y=w19) -> w25
            Is Equal(x=w21, y=w10) -> w26
            Property Node(instance in=w23) -> ("status"=w27)
            Not(x=w27) -> w28
            Logical And(w25, w24, w26, w28) -> w29
            $test <- w29
            $Output <- w23
            $"string test" <- w26
            $"bool test" <- w25
          }
        }
        $String <- "Test Running..."
        $"example.skyline-data-services.string_indicator" <- w21
        w30 = "wait"  # MobileTestState
        w2 = w30
      }
      frame "wait" {
        Wait(time to wait=100)
        w31 = "run test"  # Type
        w32 = "wait"  # MobileTestState
        Select(s=$Button, t=w31, f=w32) -> w33
        case (w33) {
          frame "run test", Default {
            $"numeric test" <- FALSE
            $"bool test" <- FALSE
            $test <- FALSE
            $"string test" <- FALSE
            $Output <- no error
            w2 = w33
          }
          frame "wait" {
            w2 = w33
          }
        }
        $String <- "Test complete"
      }
    }
    next s1 = w2
    stop if FALSE
  }
