vi "Initialize.gvi"   [LabVIEW NXG 2.0.0]
inputs:
  "server url": string
  "username": string
  "password": string
  "error in": error
outputs:
  "error out": error
  "tags": "Tag.gtype"[]
types:
  "DataType.gtype" = enum{"Double", "Integer", "String"}
  "Client Handle.gtype" = u32
  "Configuration.gtype" = cluster{"Server URL": string, "Session": "Client Handle.gtype"}
  "Tag.gtype" = cluster{"Path": string, "Datatype": "DataType.gtype", "Configuration": "Configuration.gtype"}
uses:
  NI::Skyline::Configuration::Open Configuration.gvi
  NI::Skyline::TagHTTP::Query Tags.gvi
diagram:
  w1 = ["example.skyline-data-services.bool", "example.skyline-data-services.string", "example.skyline-data-services.numeric"]
  call "Open Configuration.gvi"(server url=$"server url", username=$username, password=$password, error in=$"error in") -> (configuration=w2, error out=w3)
  call "Query Tags.gvi"(paths=w1, error in=w3, configuration=w2) -> (tags=w4, error out=w5)
  $tags <- w4
  $"error out" <- w5
